# Grasshopper definition Blocks.gh (Grasshopper 1.0.7)
# plug-ins: Blocks

id = Guid([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])
nickname = ReadBlocks(Blocks=id, DistanceThreshold=Slider(40, range=0..100))
mesh = Mesh(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)
nickname_2 = CreateAssembly(BlockPool=nickname, Obstacles=mesh, Iterations=Slider(200, range=0..200), Seed=Slider(27, range=0..100))  # -> BlockInstance, Geometry, PlacementXforms
preview = CustomPreview(
    Geometry=nickname_2.Geometry,
    Material={diffuse=RGB(221, 160, 221), emission=RGB(66, 48, 66), shine=0.5, specular=RGB(255, 255, 255), transparency=0})
